% Simulink data dictionary battery.sldd

ALPHA = -5.738
BETA = 209.9
HEAT_CAPACITY = 105.3
INTERNAL_RESISTANCE = 0.0553
LOWER_VOLT_CF = 2.75
NOMINAL_CAPACITY = 4
OCV_ALPHA = -2.631
OCV_BETA = 0.508
OCV_GAMMA = 0.556
OCV_V0 = 26.792
OCV_VL = 3.971
R_IN = 1.8
R_OUT = 15.8
T_AMB = 298
T_REF = 273
UPPER_VOLT_CF = 4.2